vi "Beamforming.gvi"   [LabVIEW Communications System Design Software 2.0.1]
inputs:
  "Num Samples": f64
  "Signal": c128[][]
  "Angles": i32 = 180
outputs:
  "Power": f64[]
  "Estimate": f64
uses:
  NI::Analysis::Generation::Ramp Pattern by Increment.gvi
  NI::Analysis::LinearAlgebra::Real Outer Product.gvi
  NI::Analysis::LinearAlgebra::Complex A x B.gvi
diagram:
  Negate(x=$Angles) -> w1
  call "Ramp Pattern by Increment.gvi"(increment=1, end=$Angles, start=w1) -> (ramp pattern=w2)
  Divide(x=w2, y=180) -> w3
  Multiply(w3, Pi) -> w4
  Sine(x=w4) -> w5
  Multiply(w5, Pi) -> w6
  Real And Imaginary To Complex(x=0, y=w6) -> w7
  Exponential(x=w7) -> w8
  Array Subset(array=$Signal, length1=$"Num Samples") -> w9
  call "Ramp Pattern by Increment.gvi"(increment=1, end=3, start=0) -> (ramp pattern=w10)
  Subtract(x=w10, y=1.5) -> w11
  call "Real Outer Product.gvi"(vector x=w11, vector y=w6) -> (outer product=w12)
  Real And Imaginary To Complex(x=0, y=w12) -> w13
  Exponential(x=w13) -> w14
  Transpose 2D Array(2D array=w14) -> (transposed array=w15)
  call "Complex A x B.gvi"(matrix A=w15, matrix B=w9) -> (A x B=w16)
  Absolute Value(x=w16) -> w17
  Square(x=w17) -> w18
  for {
    w19 = each element of w18
    Add Array Elements(numeric array=w19) -> (sum=w21)
    append w21 to w20
  }
  Divide(x=w20, y=$"Num Samples") -> w22
  Multiply(w22, w8) -> w23
  Absolute Value(x=w23) -> w24
  Add(1, w24) -> w25
  Logarithm Base 10(x=w25) -> w26
  $Power <- w26
  Complex To Polar(r * e^(i*theta)=w23) -> (r=w27)
  Array Max And Min(array=w27) -> (max index(es)=w28)
  Array Index(array=w23) -> (out0[w28]=w29)
  Complex To Polar(r * e^(i*theta)=w29) -> (theta=w30)
  Divide(x=w30, y=Pi) -> w31
  Inverse Sine(x=w31) -> w32
  Multiply(w32, 180) -> w33
  Divide(x=w33, y=Pi) -> w34
  $Estimate <- w34
