vi "Rx Multiple Synchronized Inputs.gvi"   [LabVIEW Communications System Design Software 2.0.1]
panel controls:
  "IQ rate [S/sec]": f64 = 1000000
  "Carrier Frequency [Hz]": f64 = 2000000000
  "Gain 0": f64 = 10
  "Active Antenna 0": string = "RX1"
  "Gain 1": f64 = 10
  "Active Antenna 1": string = "RX1"
  "Start Trigger Time": T1 = {"whole seconds"=0, "fractional seconds"=0.1}
  "Number of Samples Per Fetch": i64 = 16384
  "Timeout": f64 = 10
  "Stop": bool
  "Device IDs": "niUSRPClass" = "192.168.10.2; 192.168.10.3"
panel indicators:
  "Actual Rx Timestamp": T1
  "Baseband Power Spectrum": T2[]
  "Graph": f64[][]
  "Graph_2": f64[]
  "raw_base_sig": c128[][]
types:
  T1 = cluster{"whole seconds": u64, "fractional seconds": f64}
  T2 = cluster{"f0": f64, "df": f64, "magnitude": f64[]}
uses:
  NI::Analysis::Measurement::Power Spectrum for 1 Chan (CDB).gvi
diagram:
  w1 = $"Carrier Frequency [Hz]"
  call "niUSRP Open Rx Session.gvi"(niUSRP Device=$"Device IDs", reset=TRUE) -> (error out=w2, session handle out=w3)
  Property Node(instance in=w3, "Enabled Channels"="0,1", error in=w2) -> (error out=w4, instance out=w5)
  # Synchronized devices must use a Start Trigger.
  call "niUSRP Configure Time Start Trigger.gvi"(session handle=w5, start trigger time=$"Start Trigger Time", error in (no error)=w4) -> (session handle out=w6, Error Out=w7)
  # Set the attributes common to all channels.
  Property Node(instance in=w6, "IQ Rate"=$"IQ rate [S/sec]", "Carrier Frequency"=w1, error in=w7) -> ("IQ Rate"=w8, error out=w9, instance out=w10)
  # coerced IQ rate
  # sample period
  Reciprocal(x=w8) -> w11
  # Set the attributes specific to channel 0.
  Property Node(instance in=w10, sub-item="0", "Gain"=$"Gain 0", "Active Antenna"=$"Active Antenna 0", error in=w9) -> (error out=w12, instance out=w13)
  w14 = "Mimo"  # Reference Frequency Source
  w15 = "Mimo"  # Timebase Clock Source
  # Set the attributes specific to channel 1.
  # Channel 1 must also use the same
  # reference frequency and timebase clock
  # as channel 1 (in this case synchronized
  # over the MIMO cable).
  Property Node(instance in=w13, sub-item="1", "Gain"=$"Gain 1", "Active Antenna"=$"Active Antenna 1", "Reference Frequency Source"=w14, "Timebase Clock Source"=w15, error in=w12) -> (error out=w16, instance out=w17)
  call "niUSRP Set Time.gvi"(session handle=w17, apply timestamp="Now", timestamp=T1 {all zero or empty}, error in (no error)=w16, channel list="0,1") -> (session handle out=w18, Error Out=w19)
  # Set the internal
  # clocks back to
  # time 0.
  call "niUSRP Initiate.gvi"(session handle=w18, error in (no error)=w19) -> (session handle out=w20, Error Out=w21)
  s1 = w21  # shift register
  while (iteration -> i1) {
    Quotient And Remainder(x=i1, y=8) -> (x-y*floor(x/y)=w22)
    call "niUSRP Fetch Rx Data (2D CDB).gvi"(session handle=w20, number of samples=$"Number of Samples Per Fetch", timeout=$Timeout, error in (no error)=s1) -> (session handle out=w23, data=w24, timestamp=w25, Error Out=w26)
    case (w22) {
      frame Default { }
      frame 0 {
        for {
          w27 = each element of w24
          Property Node(instance in=waveform<c128> {all zero or empty}, "Y"=w27, "dt"=w11) -> (instance out=w29)
          call "Power Spectrum for 1 Chan (CDB).gvi"(signal=w29, dB on=TRUE) -> (power spectrum=w30)
          append w30 to w28
        }
        $"Baseband Power Spectrum" <- w28
      }
    }
    Math Node("signal_in"=w24) -> ("signal_out"=w31)
    ~~~
    signal_out = signal_in(1,:)
    ~~~
    Complex To Real Imaginary(x + iy=w31) -> (x=w32, y=w33)
    Build Array(w32, w33) -> w34
    $Graph <- w34
    call "Steering.gvi"(Numeric=w1) -> (steering_no_theta=w35)
    Complex To Real Imaginary(x + iy=w24) -> (x=w36)
    call "Parameter Estimation_Music.gvi"(signals=w36, steering_no_theta=w35) -> (Spectrum=w37)
    $Graph_2 <- w37
    $raw_base_sig <- w24
    $"Actual Rx Timestamp" <- w25
    Logical Or(w26, $Stop) -> w38
    next s1 = w26
    stop if w38
  }
  call "niUSRP Abort.gvi"(Handle in=w23, error in (no error)=s1) -> (Handle out=w39, Error Out=w40)
  call "niUSRP Close Session.gvi"(handle in=w39, error in=w40) -> (error out=w41)
  call "Simple Error Handler.gvi"(error in=w41)
