vi "FM Modulator.gvi"   [LabVIEW Communications System Design Software 2.0.1]
inputs:
  "carrier magnitude": f64
  "deltaf": f64
  "Input Signal": f64[]
  "dt": f64
outputs:
  "FM Signal": c128[]
uses:
  NI::Analysis::Filtering::IIR Filter with I.C. (DBL).gvi
diagram:
  call "IIR Filter with I.C. (DBL).gvi"(x=$"Input Signal", reverse coefficients=[1, -1], forward coefficients=[1]) -> (filtered x=w1)
  # $dt: dt
  Multiply($deltaf, PiTimes2) -> w2
  Multiply(w2, $dt) -> w3
  Multiply(w3, w1) -> w4
  Polar To Complex(r=$"carrier magnitude", theta=w4) -> (r * e^(i*theta)=w5)
  $"FM Signal" <- w5
