vi "Music Simulation.gvi"   [LabVIEW Communications System Design Software 2.0.1]
panel controls:
  "carrier magnitude": f64
  "deltaf": f64
  "Input Angle": f64
  "Stop": bool
panel indicators:
  "m(t)": waveform<f64>
  "BaseBand Spectrum": T1
  "Eigenvalues": c128[]
  "Eigenvectors": c128[][]
  "Eigenvalues of Interest": c128[][]
types:
  T1 = cluster{"f0": f64, "df": f64, "magnitude": f64[]}
uses:
  NI::Analysis::Generation::Sine Waveform.gvi
  NI::Analysis::Measurement::Power Spectrum for 1 Chan (CDB).gvi
  NI::Analysis::LinearAlgebra::Complex Conjugate Transpose Matrix.gvi
  NI::Analysis::LinearAlgebra::Complex A x B.gvi
  NI::Analysis::LinearAlgebra::Complex Eigenvalues and Vectors.gvi
diagram:
  Multiply(100, 3) -> w1
  w2 = $"carrier magnitude"
  w3 = $deltaf
  while {
    Add(100, w1) -> w4
    Multiply(w4, 100) -> w5
    call "Sine Waveform.gvi"(frequency=100, sample rate=2000000, samples=w5) -> (sine wave=w6)
    call "Sine Waveform.gvi"(frequency=w1, phase in=90, sample rate=2000000, samples=w5) -> (sine wave=w7)
    Waveform Multiply(w6, w7) -> w8
    # w8: m(t)
    $"m(t)" <- w8
    Property Node(instance in=w8) -> ("Y"=w9, "t0"=w10, "dt"=w11)
    call "FM Modulator.gvi"(carrier magnitude=w2, deltaf=w3, Input Signal=w9, dt=w11) -> (FM Signal=w12)
    Build Waveform Node(Y=w12, dt=w11, t0=w10) -> (output waveform=w13)
    call "Power Spectrum for 1 Chan (CDB).gvi"(signal=w13) -> (power spectrum=w14)
    $"BaseBand Spectrum" <- w14
    call "phase_shift.gvi"(Input Angle=$"Input Angle") -> (s1=w15, s2=w16, s3=w17, s4=w18)
    Property Node(instance in=w8) -> ("Y"=w19)
    Multiply(w15, w19) -> w20
    Multiply(w16, w19) -> w21
    Multiply(w17, w19) -> w22
    Multiply(w18, w19) -> w23
    Build Array(w20, w21, w22, w23) -> w24
    call "Complex Conjugate Transpose Matrix.gvi"(matrix=w24) -> (matrix conjugate transpose=w25)
    call "Complex A x B.gvi"(matrix A=w24, matrix B=w25) -> (A x B=w26)
    call "Complex Eigenvalues and Vectors.gvi"(matrix A=w26) -> (eigenvalues=w27, eigenvectors=w28)
    $Eigenvalues <- w27
    $Eigenvectors <- w28
    Array Subset(array=w28, index1=1) -> w29
    $"Eigenvalues of Interest" <- w29
    stop if $Stop
  }
