vi "Rx Multiple Synchronized Inputs.gvi"   [LabVIEW Communications System Design Software 2.0.1]
panel controls:
  "IQ rate [S/sec]": f64 = 1000000
  "Carrier Frequency [Hz]": f64 = 2000000000
  "Gain 0": f64 = 10
  "Active Antenna 0": string = "RX1"
  "Gain 1": f64 = 10
  "Active Antenna 1": string = "RX1"
  "Start Trigger Time": T1 = {"whole seconds"=0, "fractional seconds"=0.1}
  "Number of Samples Per Fetch": i64 = 16384
  "Timeout": f64 = 10
  "Stop": bool
  "Device IDs": "niUSRPClass" = "192.168.10.2; 192.168.10.3"
  "Sync": bool
panel indicators:
  "Actual Rx Timestamp": T1
  "Baseband Power Spectrum": T2[]
  "IQ Graph": f64[][]
  "Sync'd Signal": f64[][]
  "Phase Offset": c128
  "Estimated Azimuth": f64
types:
  T1 = cluster{"whole seconds": u64, "fractional seconds": f64}
  T2 = cluster{"f0": f64, "df": f64, "magnitude": f64[]}
uses:
  NI::Analysis::Measurement::Power Spectrum for 1 Chan (CDB).gvi
  NI::Analysis::Generation::Ramp Pattern by Increment.gvi
  NI::Analysis::LinearAlgebra::Real Outer Product.gvi
  NI::Analysis::LinearAlgebra::Complex A x B.gvi
  NI::Analysis::Statistics::Mean (CDB).gvi
diagram:
  w1 = $"Carrier Frequency [Hz]"
  call "niUSRP Open Rx Session.gvi"(device names=$"Device IDs", reset=TRUE) -> (error out=w2, session handle out=w3)
  Property Node(instance in=w3, "Enabled Channels"="0,1", error in=w2) -> (error out=w4, instance out=w5)
  # Synchronized devices must use a Start Trigger.
  call "niUSRP Configure Time Start Trigger.gvi"(session handle=w5, start trigger time=$"Start Trigger Time", error in=w4) -> (session handle out=w6, error out=w7)
  Property Node(instance in=w6, "IQ Rate"=$"IQ rate [S/sec]", "Carrier Frequency"=w1, error in=w7) -> ("IQ Rate"=w8, error out=w9, instance out=w10)
  # coerced IQ rate
  # sample period
  Reciprocal(x=w8) -> w11
  # Set the attributes common to all channels.
  # Set the attributes specific to channel 0.
  Property Node(instance in=w10, sub-item="0", "Gain"=$"Gain 0", "Active Antenna"=$"Active Antenna 0", error in=w9) -> (error out=w12, instance out=w13)
  w14 = "Mimo"  # Reference Frequency Source
  w15 = "Mimo"  # Timebase Clock Source
  # Set the attributes specific to channel 1.
  # Channel 1 must also use the same
  # reference frequency and timebase clock
  # as channel 1 (in this case synchronized
  # over the MIMO cable).
  Property Node(instance in=w13, sub-item="1", "Gain"=$"Gain 1", "Active Antenna"=$"Active Antenna 1", "Reference Frequency Source"=w14, "Timebase Clock Source"=w15, error in=w12) -> (error out=w16, instance out=w17)
  call "niUSRP Set Time.gvi"(session handle=w17, apply timestamp="Now", timestamp=T1 {all zero or empty}, error in=w16, channel list="0,1") -> (session handle out=w18, error out=w19)
  call "niUSRP Initiate.gvi"(session handle=w18, error in=w19) -> (session handle out=w20, error out=w21)
  # Set the internal
  # clocks back to
  # time 0.
  s1 = w21  # shift register
  while (iteration -> i1) {
    call "niUSRP Fetch Rx Data (2D CDB).gvi"(session handle=w20, number of samples=$"Number of Samples Per Fetch", timeout=$Timeout, error in=s1) -> (session handle out=w22, data=w23, timestamp=w24, error out=w25)
    s2 = f64[][] []  # shift register
    for {
      w26 = each element of w23
      Complex To Real Imaginary(x + iy=w26) -> (x=w27, y=w28)
      Build Array[ConcatenateInputs=True](s2, w27, w28) -> w29
      next s2 = w29
    }
    $"IQ Graph" <- s2
    Quotient And Remainder(x=i1, y=16) -> (x-y*floor(x/y)=w30)
    case (w30) {
      frame Default { }
      frame 0 {
        for {
          w31 = each element of w23
          Property Node(instance in=waveform<c128> {all zero or empty}, "Y"=w31, "dt"=w11) -> (instance out=w33)
          call "Power Spectrum for 1 Chan (CDB).gvi"(signal=w33, dB on=TRUE) -> (power spectrum=w34)
          append w34 to w32
        }
        $"Baseband Power Spectrum" <- w32
      }
    }
    $"Actual Rx Timestamp" <- w24
    Logical Or(w25, $Stop) -> w35
    Array Index(array=w23) -> (out0[0, _]=w36)
    Array Index(array=w23) -> (out0[1, _]=w37)
    Feedback Node(enable?=$Sync, input=w38) -> w39
    Multiply(w39, w37) -> w40
    Build Array(w36, w40) -> w41
    case (w30) {
      frame 0 {
        Array Size(array=w41) -> (size(s)=w42)
        Array Index(array=w42) -> (out0[0]=w43)
        call "Ramp Pattern by Increment.gvi"(increment=1, end=w43, start=1) -> (ramp pattern=w44)
        Multiply(180, w43) -> w45
        Negate(x=w45) -> w46
        call "Ramp Pattern by Increment.gvi"(increment=1, end=w45, start=w46) -> (ramp pattern=w47)
        Divide(x=w47, y=180) -> w48
        Multiply(w48, Pi) -> w49
        Divide(x=w49, y=w43) -> w50
        call "Real Outer Product.gvi"(vector x=w44, vector y=w50) -> (outer product=w51)
        Real And Imaginary To Complex(x=0, y=w51) -> w52
        Exponential(x=w52) -> w53
        Transpose 2D Array(2D array=w53) -> (transposed array=w54)
        call "Complex A x B.gvi"(matrix A=w54, matrix B=w41) -> (A x B=w55)
        Absolute Value(x=w55) -> w56
        for {
          w57 = each element of w56
          Add Array Elements(numeric array=w57) -> (sum=w59)
          append w59 to w58
        }
        Real And Imaginary To Complex(x=0, y=w50) -> w60
        Exponential(x=w60) -> w61
        Multiply(w58, w61) -> w62
        Complex To Polar(r * e^(i*theta)=w62) -> (r=w63)
        Array Max And Min(array=w63) -> (max index(es)=w64)
        Array Index(array=w62) -> (out0[w64]=w65)
        Complex To Polar(r * e^(i*theta)=w65) -> (theta=w66)
        Divide(x=w66, y=PiTimes2) -> w67
        Multiply(w67, SpeedOfLight) -> w68
        Divide(x=w68, y=w1) -> w69
        Divide(x=w69, y=0.1667) -> w70
        Inverse Cosine(x=w70) -> w71
        Multiply(w71, 180) -> w72
        Divide(x=w72, y=Pi) -> w73
        $"Estimated Azimuth" <- w73
      }
      frame Default { }
    }
    case ($Sync) {
      frame False, Default {
        w38 = default
      }
      frame True {
        Array Index(array=w23) -> (out0[0, _]=w74)
        Array Index(array=w23) -> (out0[1, _]=w75)
        Divide(x=w74, y=w75) -> w76
        call "Mean (CDB).gvi"(x=w76) -> (mean=w38)
      }
    }
    Complex To Polar(r * e^(i*theta)=w41) -> (r=w77, theta=w78)
    Build Array[ConcatenateInputs=True](w77, w78)
    $"Phase Offset" <- w39
    s3 = f64[][] []  # shift register
    for {
      w79 = each element of w41
      Complex To Real Imaginary(x + iy=w79) -> (x=w80, y=w81)
      Build Array[ConcatenateInputs=True](s3, w80, w81) -> w82
      next s3 = w82
    }
    $"Sync'd Signal" <- s3
    next s1 = w25
    stop if w35
  }
  call "niUSRP Abort.gvi"(session handle=w22, error in=s1) -> (session handle out=w83, error out=w84)
  call "niUSRP Close Session.gvi"(session handle=w83, error in=w84) -> (error out=w85)
  call "Simple Error Handler.gvi"(error in=w85)
