vi "Rx Multiple Synchronized Inputs.gvi"   [LabVIEW Communications System Design Software 2.0.1]
panel controls:
  "IQ rate [S/sec]": f64 = 1000000
  "Carrier Frequency [Hz]": f64 = 2000000000
  "Active Antenna": string = "RX1"
  "Gain": f64 = 10
  "Start Trigger Time": T1 = {"whole seconds"=0, "fractional seconds"=0.1}
  "Number of Samples Per Fetch": i64 = 16384
  "Timeout": f64 = 10
  "Stop": bool
  "Device IDs": "niUSRPClass" = "192.168.10.2; 192.168.10.3"
  "Num_samples_beamforming": f64
panel indicators:
  "Actual Rx Timestamp": T1
  "Baseband Power Spectrum": T2[]
  "IQ Graph": f64[][]
  "Estimated Azimuth": f64
  "Beamforming Phase Difference": c128[]
  "MUSIC Spectrum": f64[]
  "Synchronized Received Data": f64[][]
types:
  T1 = cluster{"whole seconds": u64, "fractional seconds": f64}
  T2 = cluster{"f0": f64, "df": f64, "magnitude": f64[]}
uses:
  NI::Analysis::Measurement::Power Spectrum for 1 Chan (CDB).gvi
  NI::Analysis::Filtering::Elliptic Highpass Filter NChan (DBL).gvi
  NI::Analysis::Filtering::Elliptic Lowpass Filter NChan (DBL).gvi
  NI::Analysis::Generation::Ramp Pattern by Increment.gvi
  NI::Analysis::LinearAlgebra::Real Outer Product.gvi
  NI::Analysis::LinearAlgebra::Complex A x B.gvi
diagram:
  w1 = $"Carrier Frequency [Hz]"
  call "niUSRP Open Rx Session.gvi"(device names=$"Device IDs", reset=TRUE) -> (error out=w2, session handle out=w3)
  Property Node(instance in=w3, "Enabled Channels"="0,1,2,3", error in=w2) -> (error out=w4, instance out=w5)
  # Synchronized devices must use a Start Trigger.
  call "niUSRP Configure Time Start Trigger.gvi"(session handle=w5, start trigger time=$"Start Trigger Time", error in=w4) -> (session handle out=w6, error out=w7)
  Property Node(instance in=w6, "IQ Rate"=$"IQ rate [S/sec]", "Carrier Frequency"=w1, error in=w7) -> ("IQ Rate"=w8, error out=w9, instance out=w10)
  # coerced IQ rate
  # sample period
  Reciprocal(x=w8) -> w11
  w12 = "RefIn"  # Reference Frequency Source
  # Set the attributes common to all channels.
  w13 = "PPSIn"  # Timebase Clock Source
  Property Node(instance in=w10, sub-item="0", "Gain"=$Gain, "Active Antenna"=$"Active Antenna", "Reference Frequency Source"=w12, "Timebase Clock Source"=w13, error in=w9) -> (error out=w14, instance out=w15)
  Property Node(instance in=w15, sub-item="1", "Gain"=$Gain, "Active Antenna"=$"Active Antenna", "Reference Frequency Source"=w12, "Timebase Clock Source"=w13, error in=w14) -> (error out=w16, instance out=w17)
  Property Node(instance in=w17, sub-item="2", "Gain"=$Gain, "Active Antenna"=$"Active Antenna", "Reference Frequency Source"=w12, "Timebase Clock Source"=w13, error in=w16) -> (error out=w18, instance out=w19)
  Property Node(instance in=w19, sub-item="3", "Gain"=$Gain, "Active Antenna"=$"Active Antenna", "Reference Frequency Source"=w12, "Timebase Clock Source"=w13, error in=w18) -> (error out=w20, instance out=w21)
  call "niUSRP Set Time.gvi"(session handle=w21, apply timestamp="Now", timestamp=T1 {all zero or empty}, error in=w20, channel list="0,1,2,3") -> (session handle out=w22, error out=w23)
  call "niUSRP Initiate.gvi"(session handle=w22, error in=w23) -> (session handle out=w24, error out=w25)
  # Set the internal
  # clocks back to
  # time 0.
  s1 = w25  # shift register
  while (iteration -> i1) {
    call "niUSRP Fetch Rx Data (2D CDB).gvi"(session handle=w24, number of samples=$"Number of Samples Per Fetch", timeout=$Timeout, error in=s1, channel list="0,1,2,3") -> (session handle out=w26, data=w27, timestamp=w28, error out=w29)
    s2 = f64[][] []  # shift register
    for {
      w30 = each element of w27
      Complex To Real Imaginary(x + iy=w30) -> (x=w31, y=w32)
      Build Array[ConcatenateInputs=True](s2, w31, w32) -> w33
      next s2 = w33
    }
    $"IQ Graph" <- s2
    Quotient And Remainder(x=i1, y=256) -> (x-y*floor(x/y)=w34)
    case (w34) {
      frame Default { }
      frame 0 {
        for {
          w35 = each element of w27
          Property Node(instance in=waveform<c128> {all zero or empty}, "Y"=w35, "dt"=w11) -> (instance out=w37)
          call "Power Spectrum for 1 Chan (CDB).gvi"(signal=w37, dB on=TRUE) -> (power spectrum=w38)
          append w38 to w36
        }
        $"Baseband Power Spectrum" <- w36
      }
    }
    $"Actual Rx Timestamp" <- w28
    Logical Or(w29, $Stop) -> w39
    Complex To Real Imaginary(x + iy=w27) -> (x=w40, y=w41)
    call "Elliptic Highpass Filter NChan (DBL).gvi"(signal=w40, sampling frequency=w8, cutoff frequency=20000, passband ripple=0.1, stopband attenuation=200, order=8) -> (filtered signal=w42)
    call "Elliptic Highpass Filter NChan (DBL).gvi"(signal=w41, sampling frequency=w8, cutoff frequency=20000, passband ripple=0.1, stopband attenuation=200, order=8) -> (filtered signal=w43)
    Real And Imaginary To Complex(x=w42, y=w43) -> w44
    call "edgeRemover.gvi"(Input=w44) -> (Output=w45)
    call "Elliptic Lowpass Filter NChan (DBL).gvi"(signal=w40, sampling frequency=w8, cutoff frequency=15000, passband ripple=0.1, stopband attenuation=200, order=8) -> (filtered signal=w46)
    call "Elliptic Lowpass Filter NChan (DBL).gvi"(signal=w41, sampling frequency=w8, cutoff frequency=15000, passband ripple=0.1, stopband attenuation=200, order=8) -> (filtered signal=w47)
    Real And Imaginary To Complex(x=w46, y=w47) -> w48
    call "edgeRemover.gvi"(Input=w48) -> (Output=w49)
    call "Sync.gvi"(Sig=w45, LPF Sig=w49) -> (Sync'd Signals=w50)
    case (w34) {
      frame 0 {
        Array Subset(array=w50, length1=$Num_samples_beamforming) -> w51
        Math Node("s"=w51) -> ("MUSIC_SPECTRUM"=w52)
        ~~~
        %Derived Extra informations/variable declaration
        size_s = (size(s))
        num_sigs= size_s(1)
        num_samples = size_s(2)
        d = 0.1666;
        c_f = 9e8;
        %Covariance Estimation -> s is a row vector
        estimated_covariance = s*s'
        R_inv = inv(estimated_covariance)
        %get key for sorted eig's
        %temp = abs(ones(1,num_sigs)*n);
        %[sorted_list,prev_indices] = sort(temp)
        %Assuming that we're only looking at 1 signal
        %num_sigs-1 smallest eigenvalues
        %noise_vector =zeros(num_sigs,num_sigs-1)
        %for i = 1:(num_sigs-1)
        %    noise_vector(:,i) = v(:,prev_indices(i))
        %end
        %sweep space until orthogonal component is found
        theta_sweep = (-180:180)*pi/180
        steering_vector = exp(j*[0:num_sigs-1]'*theta_sweep);
        MS = zeros(1,length(steering_vector))
        for i = 1:length(steering_vector)
            MS(i) = diag(steering_vector(:,i)'*R_inv*R_inv'*steering_vector(:,i));
        end
        MUSIC_SPECTRUM = abs(MS.^-1);
        ~~~
        $"MUSIC Spectrum" <- w52
        Negate(x=180) -> w53
        call "Ramp Pattern by Increment.gvi"(increment=1, end=180, start=w53) -> (ramp pattern=w54)
        Divide(x=w54, y=180) -> w55
        Multiply(w55, Pi) -> w56
        Real And Imaginary To Complex(x=0, y=w56) -> w57
        Exponential(x=w57) -> w58
        call "Ramp Pattern by Increment.gvi"(increment=1, end=3, start=0) -> (ramp pattern=w59)
        call "Real Outer Product.gvi"(vector x=w59, vector y=w56) -> (outer product=w60)
        Real And Imaginary To Complex(x=0, y=w60) -> w61
        Exponential(x=w61) -> w62
        Transpose 2D Array(2D array=w62) -> (transposed array=w63)
        call "Complex A x B.gvi"(matrix A=w63, matrix B=w51) -> (A x B=w64)
        Absolute Value(x=w64) -> w65
        Square(x=w65) -> w66
        for {
          w67 = each element of w66
          Add Array Elements(numeric array=w67) -> (sum=w69)
          append w69 to w68
        }
        Divide(x=w68, y=$"Number of Samples Per Fetch") -> w70
        Multiply(w70, w58) -> w71
        $"Beamforming Phase Difference" <- w71
        Complex To Polar(r * e^(i*theta)=w71) -> (r=w72)
        Array Max And Min(array=w72) -> (max index(es)=w73)
        Array Index(array=w71) -> (out0[w73]=w74)
        Complex To Polar(r * e^(i*theta)=w74) -> (theta=w75)
        Divide(x=w75, y=PiTimes2) -> w76
        Multiply(w76, SpeedOfLight) -> w77
        Divide(x=w77, y=w1) -> w78
        Divide(x=w78, y=0.1667) -> w79
        Inverse Sine(x=w79) -> w80
        Multiply(w80, 180) -> w81
        Divide(x=w81, y=Pi) -> w82
        $"Estimated Azimuth" <- w82
      }
      frame Default { }
    }
    Complex To Real Imaginary(x + iy=w50) -> (x=w83, y=w84)
    Build Array[ConcatenateInputs=True](w83, w84) -> w85
    $"Synchronized Received Data" <- w85
    next s1 = w29
    stop if w39
  }
  call "niUSRP Abort.gvi"(session handle=w26, error in=s1) -> (session handle out=w86, error out=w87)
  call "niUSRP Close Session.gvi"(session handle=w86, error in=w87) -> (error out=w88)
  call "Simple Error Handler.gvi"(error in=w88)
