vi "Carrier.gvi"   [LabVIEW Communications System Design Software 2.0.1]
inputs:
  "Samples": f64
  "Frequency": f64
outputs:
  "Output": waveform<c128>
uses:
  NI::Analysis::Generation::Sine Waveform.gvi
diagram:
  Multiply($Frequency, 10) -> w1
  call "Sine Waveform.gvi"(frequency=$Frequency, sample rate=w1, samples=$Samples) -> (sine wave=w2)
  # $Samples: # of Samples
  Property Node(instance in=w2) -> ("Y"=w3, "t0"=w4, "dt"=w5)
  call "Sine Waveform.gvi"(frequency=$Frequency, phase in=90, sample rate=w1, samples=$Samples) -> (sine wave=w6)
  Property Node(instance in=w6) -> ("Y"=w7)
  Real And Imaginary To Complex(x=w3, y=w7) -> w8
  Build Waveform Node(Y=w8, dt=w5, t0=w4) -> (output waveform=w9)
  $Output <- w9
