vi "phase_shift.gvi"   [LabVIEW Communications System Design Software 2.0.1]
inputs:
  "Input Angle": f64
outputs:
  "s1": c128
  "s2": c128
  "s3": c128
  "s4": c128
diagram:
  C Code Node("ang"=$"Input Angle") -> ("rx4"=w1, "rx1"=w2, "rx2"=w3, "rx3"=w4)
  ~~~
  //Steering Vector
  double pi = 3.141592653;
  double d = 0.166666;
  double c = 3*pow(10,8);
  double f = 1*pow(10,8);
  rx1 = 2*pi*d*sin(ang)*f/c;
  rx2 = 2*pi*2*d*sin(ang)*f/c;
  rx3 = 2*pi*3*d*sin(ang)*f/c;
  rx4 = 2*pi*4*d*sin(ang)*f/c;
  ~~~
  Polar To Complex(r=1, theta=w2) -> (r * e^(i*theta)=w5)
  $s1 <- w5
  Polar To Complex(r=1, theta=w3) -> (r * e^(i*theta)=w6)
  $s2 <- w6
  Polar To Complex(r=1, theta=w4) -> (r * e^(i*theta)=w7)
  $s3 <- w7
  Polar To Complex(r=1, theta=w1) -> (r * e^(i*theta)=w8)
  $s4 <- w8
