vi "Carrier_signal.gvi"   [LabVIEW Communications System Design Software 2.0.1]
inputs:
  "Carrier Freqeuncy": f64
  "Number of Samples": f64
  "Sampling Rate": f64
outputs:
  "Out": c128[]
uses:
  NI::Analysis::Generation::Sine Waveform.gvi
diagram:
  call "Sine Waveform.gvi"(frequency=$"Carrier Freqeuncy", sample rate=$"Sampling Rate", samples=$"Number of Samples") -> (sine wave=w1)
  Property Node(instance in=w1) -> ("Y"=w2)
  call "Sine Waveform.gvi"(frequency=$"Carrier Freqeuncy", phase in=90, sample rate=$"Sampling Rate", samples=$"Number of Samples") -> (sine wave=w3)
  Property Node(instance in=w3) -> ("Y"=w4)
  Real And Imaginary To Complex(x=w4, y=w2) -> w5
  $Out <- w5
