vi "Main.gvi"   [LabVIEW Communications System Design Software 2.0.1]
panel controls:
  "Stop": bool
  "Carrier Frequency": f64
  "Sampling Frequency": i32
  "Number of Samples": i32
  "Num Receivers": i32
  "Angle": f64
panel indicators:
  "Original Signal": waveform<f64>
  "Transmitted with Carrier(at Carriers Sampling Frequency)": f64[][]
  "Received Signal with noise": f64[][]
  "Delayed Signals": c128[][]
  "Graph": f64[]
  "Graph_2": f64[]
  "Array": f64[]
  "Array_2": f64[]
  "Polar Graph": c128[]
diagram:
  while {
    Build Waveform Node()
    call "transmitted_signal.gvi"(Carrier Freqeuncy=$"Carrier Frequency", Sampling Freqeuncy=$"Sampling Frequency", Number of Samples=$"Number of Samples") -> (SwC=w1, SnoC=w2, dt=w3)
    Build Waveform Node(Y=w2, dt=w3) -> (output waveform=w4)
    $"Original Signal" <- w4
    Complex To Real Imaginary(x + iy=w1) -> (x=w5, y=w6)
    Build Array(w5, w6) -> w7
    $"Transmitted with Carrier(at Carriers Sampling Frequency)" <- w7
    Multiply(w2, 0) -> w8
    call "noise_adder.gvi"(Number of Samples=$"Number of Samples", Real=w2, Imag=w8) -> (Received Signal with noise=w9, Real Signal=w10)
    $"Received Signal with noise" <- w9
    Reciprocal(x=$"Carrier Frequency") -> w11
    Multiply(w11, 300000000, 0.5) -> w12
    call "Signal Delayer.gvi"(signal=w10, num_signals=$"Num Receivers", angle=$Angle, distance=w12, Carrier Frequency=$"Carrier Frequency") -> (Out=w13, steering_no_theta=w14)
    Math Node("signal"=w13) -> ("out_b"=w15, "angles_o"=w16, "out_s"=w17)
    ~~~
    sz = size(signal);
    %angles is a row matrix of length angles
    angles = (-sz(1)*180:sz(1)*180)/(180) * pi;
    steering_base = angles/sz(1);
    %assuming uniform and linear array
    steering = exp(j*(1:sz(1))'*steering_base)
    %steering is now a num_receivers by num angles matrix
    steered_arr = steering'*signal;
    out_b = sum(abs(steered_arr),2)';
    out_s =size(out_b)
    angles_o = exp(j*steering_base).*out_b;
    ~~~
    $"Polar Graph" <- w16
    $"Delayed Signals" <- w13
    call "Parameter Estimation_Music.gvi"(signals=w13, steering_no_theta=w14) -> (Spectrum=w18)
    $Graph <- w18
    $Graph_2 <- w15
    $Array <- w15
    $Array_2 <- w17
    stop if $Stop
  }
