vi "noise_adder.gvi"   [LabVIEW Communications System Design Software 2.0.1]
inputs:
  "Number of Samples": i32
  "Real": f64[]
  "Imag": f64[]
outputs:
  "Received Signal with noise": f64[][]
  "Real Signal": f64[]
uses:
  NI::Analysis::Generation::Gaussian White Noise.gvi
diagram:
  call "Gaussian White Noise.gvi"(samples=$"Number of Samples", seed=3) -> (Gaussian white noise=w1)
  Add($Imag, w1) -> w2
  call "Gaussian White Noise.gvi"(samples=$"Number of Samples") -> (Gaussian white noise=w3)
  Add($Real, w3) -> w4
  Build Array(w4, w2) -> w5
  $"Received Signal with noise" <- w5
  $"Real Signal" <- w4
