vi "transmitted_signal.gvi"   [LabVIEW Communications System Design Software 2.0.1]
inputs:
  "Carrier Freqeuncy": f64
  "Sampling Freqeuncy": i32
  "Number of Samples": i32
outputs:
  "SwC": c128[]
  "SnoC": f64[]
  "dt": f64
panel indicators:
  "Array": f64[]
  "time": f64[]
uses:
  NI::Analysis::Generation::Sine Waveform.gvi
diagram:
  call "Sine Waveform.gvi"(amplitude=2, frequency=40000, phase in=90, sample rate=$"Sampling Freqeuncy", samples=$"Number of Samples") -> (sine wave=w1)
  call "Sine Waveform.gvi"(amplitude=2, frequency=20000, sample rate=$"Sampling Freqeuncy", samples=$"Number of Samples") -> (sine wave=w2)
  Waveform Add(w2, w1) -> w3
  $SnoC <- w3
  Property Node(instance in=w3) -> ("Y"=w4, "dt"=w5)
  $dt <- w5
  Math Node("y"=w4, "dt"=w5, "carrier_f"=$"Carrier Freqeuncy") -> ("signal"=w6, "array_size"=w7, "Time_array"=w8)
  ~~~
  time= (((0:length(y)-1))*dt)
  carrier = exp(j*time*2*pi*carrier_f)
  array_size = size(carrier)
  signal = y.*carrier
  Time_array = time
  ~~~
  $SwC <- w6
  $Array <- w7
  $time <- w8
