vi "Function.gvi"   [LabVIEW Communications System Design Software 2.0.1]
panel controls:
  "Amplitude 1": f64
  "Frequency 1": f64
  "Phase 1": f64
  "Amplitude 2": f64
  "Frequency 2": f64
  "Phase 2": f64
  "Stop": bool
panel indicators:
  "Graph": waveform<f64>[]
uses:
  NI::Analysis::Generation::Sine Waveform.gvi
diagram:
  while {
    call "Sine Waveform.gvi"(amplitude=$"Amplitude 2", frequency=$"Frequency 2", phase in=$"Phase 2") -> (sine wave=w1)
    call "Sine Waveform.gvi"(amplitude=$"Amplitude 1", frequency=$"Frequency 1", phase in=$"Phase 1") -> (sine wave=w2)
    Waveform Divide(x=w2, y=w1) -> w3
    Waveform Multiply(w3, w1) -> w4
    Build Array(w2, w1, w4) -> w5
    $Graph <- w5
    stop if $Stop
  }
