vi "Main.gvi"   [LabVIEW Communications System Design Software 2.0.1]
panel controls:
  "IQ rate [S/sec]": f64 = 1000000
  "Carrier Frequency [Hz]": f64 = 900000000
  "Active Antenna": string = "RX1"
  "Gain": f64 = 10
  "Start Trigger Time": T1 = {"whole seconds"=0, "fractional seconds"=0.1}
  "Number of Samples Per Fetch": i64 = 16384
  "Timeout": f64 = 10
  "Device IDs": "niUSRPClass" = "192.168.10.2; 192.168.10.3; 192.168.10.4; 192.168.10.5"
  "Stop": bool
  "Num_samples_beamforming": f64
  "Disp Data?": bool
panel indicators:
  "Sync IQ": f64[][]
  "Baseband Power Spectrum": T2[]
  "Raw IQ": f64[][]
  "Baseband Power Spectrum_Sync'd": T2[]
  "Estimated Azimuth": f64
  "Beamforming Powr Plot": f64[]
  "Actual Rx Timestamp": T1
types:
  T1 = cluster{"whole seconds": u64, "fractional seconds": f64}
  T2 = cluster{"f0": f64, "df": f64, "magnitude": f64[]}
uses:
  NI::Analysis::Measurement::Power Spectrum for 1 Chan (CDB).gvi
diagram:
  call "niUSRP Open Rx Session.gvi"(niUSRP Device=$"Device IDs", reset=TRUE) -> (error out=w1, session handle out=w2)
  Property Node(instance in=w2, "Enabled Channels"="0,1,2,3", error in=w1) -> (error out=w3, instance out=w4)
  # Synchronized devices must use a Start Trigger.
  call "niUSRP Configure Time Start Trigger.gvi"(session handle=w4, start trigger time=$"Start Trigger Time", error in (no error)=w3) -> (session handle out=w5, Error Out=w6)
  Property Node(instance in=w5, "IQ Rate"=$"IQ rate [S/sec]", "Carrier Frequency"=$"Carrier Frequency [Hz]", error in=w6) -> ("IQ Rate"=w7, error out=w8, instance out=w9)
  Reciprocal(x=w7) -> w10
  w11 = $Stop
  call "Radio Init_Rx.gvi"(niusrp out=w9, error out=w8, Gain=$Gain, Active Antenna=$"Active Antenna", Reference Frequency Source="RefIn", Timebase Clock Source="PPSIn") -> (session handle=w12, error in (no error)=w13)
  call "niUSRP Set Time.gvi"(session handle=w12, apply timestamp="Next Timebase Edge", error in (no error)=w13, channel list="0,1,2,3") -> (session handle out=w14, Error Out=w15)
  call "niUSRP Initiate.gvi"(session handle=w14, error in (no error)=w15) -> (session handle out=w16, Error Out=w17)
  w18 = $"Number of Samples Per Fetch"
  w19 = $Timeout
  while (iteration -> i1) {
    Quotient And Remainder(x=i1, y=256) -> (x-y*floor(x/y)=w20)
    call "niUSRP Fetch Rx Data (2D CDB).gvi"(session handle=w16, number of samples=w18, timeout=w19, error in (no error)=w17, channel list="0,1,2,3") -> (session handle out=w21, data=w22, timestamp=w23, Error Out=w24)
    call "FnS.gvi"(Sampling Frequency=w7, data=w22) -> (Sync IQ=w25)
    case (w20) {
      frame Default { }
      frame 0 {
        for {
          w26 = each element of w25
          Property Node(instance in=waveform<c128> {all zero or empty}, "Y"=w26, "dt"=w10) -> (instance out=w28)
          call "Power Spectrum for 1 Chan (CDB).gvi"(signal=w28, dB on=TRUE) -> (power spectrum=w29)
          append w29 to w27
        }
        $"Baseband Power Spectrum_Sync'd" <- w27
      }
    }
    case (w20) {
      frame Default { }
      frame 0 {
        for {
          w30 = each element of w22
          Property Node(instance in=waveform<c128> {all zero or empty}, "Y"=w30, "dt"=w10) -> (instance out=w32)
          call "Power Spectrum for 1 Chan (CDB).gvi"(signal=w32, dB on=TRUE) -> (power spectrum=w33)
          append w33 to w31
        }
        $"Baseband Power Spectrum" <- w31
      }
    }
    case (w20) {
      frame 0 {
        call "Beamforming.gvi"(Num Samples=$Num_samples_beamforming, Signal=w25, Angles=180) -> (Power=w34, Estimate=w35)
        $"Beamforming Powr Plot" <- w34
        $"Estimated Azimuth" <- w35
      }
      frame Default { }
    }
    case ($"Disp Data?") {
      frame False, Default { }
      frame True {
        Complex To Real Imaginary(x + iy=w25) -> (x=w36, y=w37)
        Build Array[ConcatenateInputs=True](w36, w37) -> w38
        $"Sync IQ" <- w38
        Complex To Real Imaginary(x + iy=w22) -> (x=w39, y=w40)
        Build Array[ConcatenateInputs=True](w39, w40) -> w41
        $"Raw IQ" <- w41
      }
    }
    $"Actual Rx Timestamp" <- w23
    Logical Or(w11, w24) -> w42
    stop if w42
  }
  call "niUSRP Abort.gvi"(Handle in=w21, error in (no error)=w24) -> (Handle out=w43, Error Out=w44)
  call "niUSRP Close Session.gvi"(handle in=w43, error in=w44) -> (error out=w45)
  call "Simple Error Handler.gvi"(error in=w45)
