vi "Radio Init_Rx.gvi"   [LabVIEW Communications System Design Software 2.0.1]
inputs:
  "niusrp out": "niUSRPClass"
  "error out": error
  "Gain": f64 = 10
  "Active Antenna": string = "RX1"
  "Reference Frequency Source": string = "RefIn"
  "Timebase Clock Source": string = "PPSIn"
outputs:
  "session handle": "niUSRPClass"
  "error in (no error)": error
diagram:
  Property Node(instance in=$"niusrp out", sub-item="0", "Gain"=$Gain, "Active Antenna"=$"Active Antenna", "Reference Frequency Source"=$"Reference Frequency Source", "Timebase Clock Source"=$"Timebase Clock Source", error in=$"error out") -> (error out=w1, instance out=w2)
  Property Node(instance in=w2, sub-item="1", "Gain"=$Gain, "Active Antenna"=$"Active Antenna", "Reference Frequency Source"=$"Reference Frequency Source", "Timebase Clock Source"=$"Timebase Clock Source", error in=w1) -> (error out=w3, instance out=w4)
  Property Node(instance in=w4, sub-item="2", "Gain"=$Gain, "Active Antenna"=$"Active Antenna", "Reference Frequency Source"=$"Reference Frequency Source", "Timebase Clock Source"=$"Timebase Clock Source", error in=w3) -> (error out=w5, instance out=w6)
  Property Node(instance in=w6, sub-item="3", "Gain"=$Gain, "Active Antenna"=$"Active Antenna", "Reference Frequency Source"=$"Reference Frequency Source", "Timebase Clock Source"=$"Timebase Clock Source", error in=w5) -> (error out=w7, instance out=w8)
  $"session handle" <- w8
  $"error in (no error)" <- w7
