vi "Rx Multiple Synchronized Inputs.gvi"   [LabVIEW Communications System Design Software 2.0.1]
panel controls:
  "IQ rate [S/sec]": f64 = 1000000
  "Carrier Frequency [Hz]": f64 = 2000000000
  "Gain 0": f64 = 10
  "Active Antenna 0": string = "RX1"
  "Gain 1": f64 = 10
  "Active Antenna 1": string = "RX1"
  "Start Trigger Time": T1 = {"whole seconds"=0, "fractional seconds"=0.1}
  "Number of Samples Per Fetch": i64 = 16384
  "Timeout": f64 = 10
  "Stop": bool
  "Device IDs": "niUSRPClass" = "192.168.10.2; 192.168.10.3"
  "Sync": bool
  "Active Antenna 2": string = "RX1"
  "Active Antenna 3": string = "RX1"
  "Num_samples_beamforming": f64
panel indicators:
  "Actual Rx Timestamp": T1
  "Baseband Power Spectrum": T2[]
  "IQ Graph": f64[][]
  "Sync'd Signal": f64[][]
  "Phase Offset": c128
  "Estimated Azimuth": f64
  "Numeric Array Output": c128[][]
  "Polar Graph": c128[]
  "Graph": f64[]
types:
  T1 = cluster{"whole seconds": u64, "fractional seconds": f64}
  T2 = cluster{"f0": f64, "df": f64, "magnitude": f64[]}
uses:
  NI::Analysis::Measurement::Power Spectrum for 1 Chan (CDB).gvi
  NI::Analysis::Generation::Ramp Pattern by Increment.gvi
  NI::Analysis::LinearAlgebra::Real Outer Product.gvi
  NI::Analysis::LinearAlgebra::Complex A x B.gvi
diagram:
  w1 = $"Carrier Frequency [Hz]"
  call "niUSRP Open Rx Session.gvi"(niUSRP Device=$"Device IDs", reset=TRUE) -> (error out=w2, session handle out=w3)
  Property Node(instance in=w3, "Enabled Channels"="0,1,2,3", error in=w2) -> (error out=w4, instance out=w5)
  # Synchronized devices must use a Start Trigger.
  call "niUSRP Configure Time Start Trigger.gvi"(session handle=w5, start trigger time=$"Start Trigger Time", error in (no error)=w4) -> (session handle out=w6, Error Out=w7)
  Property Node(instance in=w6, "IQ Rate"=$"IQ rate [S/sec]", "Carrier Frequency"=w1, error in=w7) -> ("IQ Rate"=w8, error out=w9, instance out=w10)
  # coerced IQ rate
  # sample period
  Reciprocal(x=w8) -> w11
  w12 = "RefIn"  # Reference Frequency Source
  # Set the attributes common to all channels.
  w13 = "PPSIn"  # Timebase Clock Source
  Property Node(instance in=w10, sub-item="0", "Gain"=$"Gain 0", "Active Antenna"=$"Active Antenna 0", "Reference Frequency Source"=w12, "Timebase Clock Source"=w13, error in=w9) -> (error out=w14, instance out=w15)
  Property Node(instance in=w15, sub-item="1", "Gain"=$"Gain 1", "Active Antenna"=$"Active Antenna 1", "Reference Frequency Source"=w12, "Timebase Clock Source"=w13, error in=w14) -> (error out=w16, instance out=w17)
  Property Node(instance in=w17, sub-item="2", "Gain"=$"Gain 1", "Active Antenna"=$"Active Antenna 2", "Reference Frequency Source"=w12, "Timebase Clock Source"=w13, error in=w16) -> (error out=w18, instance out=w19)
  Property Node(instance in=w19, sub-item="3", "Gain"=$"Gain 1", "Active Antenna"=$"Active Antenna 3", "Reference Frequency Source"=w12, "Timebase Clock Source"=w13, error in=w18) -> (error out=w20, instance out=w21)
  call "niUSRP Set Time.gvi"(session handle=w21, apply timestamp="Now", timestamp=T1 {all zero or empty}, error in (no error)=w20, channel list="0,1,2,3") -> (session handle out=w22, Error Out=w23)
  call "niUSRP Initiate.gvi"(session handle=w22, error in (no error)=w23) -> (session handle out=w24, Error Out=w25)
  # Set the internal
  # clocks back to
  # time 0.
  s1 = w25  # shift register
  while (iteration -> i1) {
    call "niUSRP Fetch Rx Data (2D CDB).gvi"(session handle=w24, number of samples=$"Number of Samples Per Fetch", timeout=$Timeout, error in (no error)=s1, channel list="0,1,2,3") -> (session handle out=w26, data=w27, timestamp=w28, Error Out=w29)
    s2 = f64[][] []  # shift register
    for {
      w30 = each element of w27
      Complex To Real Imaginary(x + iy=w30) -> (x=w31, y=w32)
      Build Array[ConcatenateInputs=True](s2, w31, w32) -> w33
      next s2 = w33
    }
    $"IQ Graph" <- s2
    Quotient And Remainder(x=i1, y=256) -> (x-y*floor(x/y)=w34)
    case (w34) {
      frame Default { }
      frame 0 {
        for {
          w35 = each element of w27
          Property Node(instance in=waveform<c128> {all zero or empty}, "Y"=w35, "dt"=w11) -> (instance out=w37)
          call "Power Spectrum for 1 Chan (CDB).gvi"(signal=w37, dB on=TRUE) -> (power spectrum=w38)
          append w38 to w36
        }
        $"Baseband Power Spectrum" <- w36
      }
    }
    $"Actual Rx Timestamp" <- w28
    Logical Or(w29, $Stop) -> w39
    Feedback Node(enable?=$Sync, input=w40) -> w41
    for {
      w42 = each element of w41
      w43 = each element of w27
      Multiply(w42, w43) -> w45
      append w45 to w44
    }
    case (w34) {
      frame 0 {
        Array Subset(array=w44, length1=$Num_samples_beamforming) -> w46
        Math Node("s"=w46) -> ("MUSIC_SPECTRUM"=w47)
        ~~~
        %Derived Extra informations/variable declaration
        size_s = (size(s))
        num_sigs= size_s(1)
        num_samples = size_s(2)
        d = 0.1666;
        c_f = 9e8;
        %Covariance Estimation -> s is a row vector
        estimated_covariance = s*s'
        [v,n] = eig(estimated_covariance)
        %get key for sorted eig's
        temp = abs(ones(1,num_sigs)*n);
        [sorted_list,prev_indices] = sort(temp)
        %Assuming that we're only looking at 1 signal
        %num_sigs-1 smallest eigenvalues
        noise_vector =zeros(num_sigs,num_sigs-1)
        for i = 1:(num_sigs-1)
            noise_vector(:,i) = v(:,prev_indices(i))
        end
        %sweep space until orthogonal component is found
        theta_sweep = (-90:90)*pi/180
        steering_vector = exp(2*pi*j*[0:num_sigs-1]'*d/c_f*sin(theta_sweep));
        MS = zeros(1,length(steering_vector))
        for i = 1:length(steering_vector)
            MS(i) = steering_vector(:,i)'*(noise_vector)*noise_vector'*steering_vector(:,i);
        end
        MUSIC_SPECTRUM = abs(MS.^-1);
        ~~~
        $Graph <- w47
        Negate(x=180) -> w48
        call "Ramp Pattern by Increment.gvi"(increment=1, end=180, start=w48) -> (ramp pattern=w49)
        Divide(x=w49, y=180) -> w50
        Multiply(w50, Pi) -> w51
        Real And Imaginary To Complex(x=0, y=w51) -> w52
        Exponential(x=w52) -> w53
        call "Ramp Pattern by Increment.gvi"(increment=1, end=3, start=0) -> (ramp pattern=w54)
        call "Real Outer Product.gvi"(vector x=w54, vector y=w51) -> (outer product=w55)
        Real And Imaginary To Complex(x=0, y=w55) -> w56
        Exponential(x=w56) -> w57
        Transpose 2D Array(2D array=w57) -> (transposed array=w58)
        call "Complex A x B.gvi"(matrix A=w58, matrix B=w46) -> (A x B=w59)
        Absolute Value(x=w59) -> w60
        Square(x=w60) -> w61
        for {
          w62 = each element of w61
          Add Array Elements(numeric array=w62) -> (sum=w64)
          append w64 to w63
        }
        Divide(x=w63, y=$"Number of Samples Per Fetch") -> w65
        Multiply(w65, w53) -> w66
        $"Polar Graph" <- w66
        Complex To Polar(r * e^(i*theta)=w66) -> (r=w67)
        Array Max And Min(array=w67) -> (max index(es)=w68)
        Array Index(array=w66) -> (out0[w68]=w69)
        Complex To Polar(r * e^(i*theta)=w69) -> (theta=w70)
        Divide(x=w70, y=PiTimes2) -> w71
        Multiply(w71, SpeedOfLight) -> w72
        Divide(x=w72, y=w1) -> w73
        Divide(x=w73, y=0.1667) -> w74
        Inverse Sine(x=w74) -> w75
        Multiply(w75, 180) -> w76
        Divide(x=w76, y=Pi) -> w77
        $"Estimated Azimuth" <- w77
      }
      frame Default { }
    }
    case ($Sync) {
      frame False, Default {
        w40 = w41
      }
      frame True {
        Array Size(array=w27) -> (size(s)=w78)
        Array Index(array=w78) -> (out0[0]=w79)
        for (N = w79) (iteration -> i2) {
          Array Index(array=w27) -> (out0[0, _]=w80)
          Array Index(array=w27) -> (out0[i2, _]=w81)
          Divide(x=w80, y=w81) -> w82
          append w82 to w40
        }
      }
    }
    s3 = f64[][] []  # shift register
    for {
      w83 = each element of w44
      Complex To Real Imaginary(x + iy=w83) -> (x=w84, y=w85)
      Build Array[ConcatenateInputs=True](s3, w84, w85) -> w86
      next s3 = w86
    }
    $"Sync'd Signal" <- s3
    $"Numeric Array Output" <- w27
    next s1 = w29
    stop if w39
  }
  call "niUSRP Abort.gvi"(Handle in=w26, error in (no error)=s1) -> (Handle out=w87, Error Out=w88)
  call "niUSRP Close Session.gvi"(handle in=w87, error in=w88) -> (error out=w89)
  call "Simple Error Handler.gvi"(error in=w89)
