vi "Beamforming.gvi"   [LabVIEW Communications System Design Software 2.0.1]
inputs:
  "M": f64
  "Num Samples": f64
  "Signal": c128[][]
  "Angles": i32 = 180
outputs:
  "Power": f64[]
  "Estimate": f64
uses:
  NI::Analysis::Generation::Ramp Pattern by Increment.gvi
  NI::Analysis::LinearAlgebra::Real Outer Product.gvi
  NI::Analysis::LinearAlgebra::Complex A x B.gvi
diagram:
  Negate(x=$Angles) -> w1
  call "Ramp Pattern by Increment.gvi"(increment=1, end=$Angles, start=w1) -> (ramp pattern=w2)
  Divide(x=w2, y=180) -> w3
  Multiply(w3, Pi) -> w4
  Sine(x=w4) -> w5
  Multiply(w5, Pi) -> w6
  Real And Imaginary To Complex(x=0, y=w6) -> w7
  Exponential(x=w7) -> w8
  Array Subset(array=$Signal, length1=$"Num Samples") -> w9
  call "Ramp Pattern by Increment.gvi"(increment=1, end=$M, start=0) -> (ramp pattern=w10)
  Divide(x=$M, y=2) -> w11
  Subtract(x=w10, y=w11) -> w12
  call "Real Outer Product.gvi"(vector x=w12, vector y=w6) -> (outer product=w13)
  Real And Imaginary To Complex(x=0, y=w13) -> w14
  Exponential(x=w14) -> w15
  Transpose 2D Array(2D array=w15) -> (transposed array=w16)
  call "Complex A x B.gvi"(matrix A=w16, matrix B=w9) -> (A x B=w17)
  Absolute Value(x=w17) -> w18
  Square(x=w18) -> w19
  for {
    w20 = each element of w19
    Add Array Elements(numeric array=w20) -> (sum=w22)
    append w22 to w21
  }
  Divide(x=w21, y=$"Num Samples") -> w23
  Multiply(w23, w8) -> w24
  Absolute Value(x=w24) -> w25
  Add(1, w25) -> w26
  Logarithm Base 10(x=w26) -> w27
  $Power <- w27
  Complex To Polar(r * e^(i*theta)=w24) -> (r=w28)
  Array Max And Min(array=w28) -> (max index(es)=w29)
  Array Index(array=w24) -> (out0[w29]=w30)
  Complex To Polar(r * e^(i*theta)=w30) -> (theta=w31)
  Divide(x=w31, y=Pi) -> w32
  Inverse Sine(x=w32) -> w33
  Multiply(w33, 180) -> w34
  Divide(x=w34, y=Pi) -> w35
  $Estimate <- w35
