vi "Basic Multitone.gvi"   [LabVIEW NXG]
inputs:
  "phase relationship": T1 = "random"
  "start frequency": f64 = 10
  "seed": i32 = -1
  "delta frequency": f64 = 100
  "error in (no error)": error
  "#tones": i32 = 3
  "reset signal": bool
  "amplitude": f64 = -1
  "sampling info": cluster{"Fs": f64, "#s": f64} = {"Fs"=1000, "#s"=1000}
  "coerce frequencies?": bool
outputs:
  "signal out": waveform<f64>
  "crest factor": f64
  "actual tone frequencies": f64[]
  "error out": error
panel indicators:
  "Graph": f64[]
types:
  T1 = enum{"random", "linear difference", "linear phase"}
diagram:
  for (N = $"#tones") (iteration -> i1) {
    Multiply($amplitude, 1.414) -> w2
    Multiply($"delta frequency", i1) -> w3
    Add($"start frequency", w3) -> w4
    w5 = cluster{"freq (Hz)": f64, "amplitude (dB)": f64} {all zero or empty}
    Property Node(instance in=w5, "amplitude (dB)"=w2, "freq (Hz)"=w4) -> (instance out=w6)
    append w6 to w1
  }
  Property Node(instance in=$"sampling info") -> ("#s"=w7, "Fs"=w8)
  Initialize Array(element=0+0i, size=w7) -> w9
  Reciprocal(x=w8) -> w10
  w11 = cluster{"t0": f64, "dt": f64, "Y": c128[]} {"t0"=0, "dt"=1, "Y"=[]}
  Property Node(instance in=w11, "Y"=w9, "dt"=w10) -> (instance out=w12)
  call "MT Add MultiTone.gvi"(input complex waveform=w12, tones=w1, reset?=TRUE) -> (output complex waveform=w13)
  Property Node(instance in=w13) -> ("Y"=w14)
  Complex To Real Imaginary(x + iy=w14) -> (y=w15)
  $Graph <- w15
  Build Waveform Node(Y=w15, dt=w10) -> (output waveform=w16)
  $"signal out" <- w16
  $"error out" <- $"error in (no error)"
