vi "FFT Power Spectrum and PSD for 1 Chan2.gvi"   [LabVIEW NXG]
inputs:
  "time signal": waveform<f64> = {dt=0.1, Y=[]}
  "window": u32 = 1
  "db on": bool
  "error in": error
  "restart averaging": bool
  "export mode": u16
  "averaging parameters": T3 = {"averaging mode"="No averaging", "weighting mode"="Exponential", "number of averages"=10}
  "window parameter": f64 = NaN
outputs:
  "power spectrum / psd": T1
  "averaging done": bool
  "averages completed": f64
  "error out": error
types:
  T1 = cluster{"f0": f64, "df": f64, "magnitude": f64[]}
  T2 = enum{"No averaging", "Vector averaging", "RMS averaging", "Peak hold"}
  T3 = cluster{"averaging mode": T2, "weighting mode": enum{"Linear", "Exponential"}, "number of averages": u32}
  T4 = cluster{"averaging parameters": T3, "window": u32}
  T5 = cluster{"block size": i32, "dt": f64, "spectrum parameters": T4, "df": f64, "averages completed": f64, "complex spectrum": c128[], "real spectrum": f64[], "t0 history": f64, "dt history": f64, "timestamp": f64, "lin avg done": bool}
diagram:
  Is Equal(x=$"export mode", y=1) -> w1
  case ($"error in") {
    frame No Error {
      Is First Call() -> w6
      Logical Or($"restart averaging", w6) -> w7
      s1 = uninitialised  # shift register
      while {
        Select(s=w7, t=T5 {all zero or empty}, f=s1) -> w8
        call "ma_FFT Power Spectrum and PS Density no State.gvi"(time signal=$"time signal", window=$window, averaging parameters=$"averaging parameters", db on=$"db on", error in=$"error in", restart averaging=w7, ps density=w1, state info=w8, window parameter=$"window parameter") -> (power spectrum=w4, averages completed=w5, error out=w2, averaging done=w3, state info 2=w9)
        next s1 = w9
        continue if FALSE
      }
    }
    frame Error {
      w2 = $"error in"
      w3 = default
      w4 = default
      w5 = default
    }
  }
  $"averaging done" <- w3
  $"power spectrum / psd" <- w4
  $"averages completed" <- w5
  $"error out" <- w2
