vi "FFT Power Spectrum for 1 Chan (CDB)2.gvi"   [LabVIEW NXG]
inputs:
  "time signal": cluster{"t0": timestamp, "dt": f64, "Y": c128[]}
  "window": u32 = 1
  "dB On (F)": bool
  "error in (no error)": error
  "restart averaging (F)": bool
  "averaging parameters": T3 = {"averaging mode"="No averaging", "weighting mode"="Exponential", "number of averages"=10}
outputs:
  "power spectrum": T1
  "averages completed": f64
  "Error Out": error
  "averaging done": bool
types:
  T1 = cluster{"f0": f64, "df": f64, "magnitude": f64[]}
  T2 = enum{"No averaging", "Vector averaging", "RMS averaging", "Peak hold"}
  T3 = cluster{"averaging mode": T2, "weighting mode": enum{"Linear", "Exponential"}, "number of averages": u32}
  T4 = cluster{"averaging parameters": T3, "window": u32}
  T5 = cluster{"block size": i32, "dt": f64, "spectrum parameters": T4, "df": f64, "averages completed": f64, "complex spectrum": c128[], "real spectrum": f64[], "t0 history": f64, "dt history": f64, "timestamp": f64, "lin avg done": bool}
diagram:
  case ($"error in (no error)") {
    frame No Error {
      Is First Call() -> w2
      Logical Or($"restart averaging (F)", w2) -> w3
      s1 = uninitialised  # shift register
      while {
        Select(s=w3, t=T5 {all zero or empty}, f=s1) -> w4
        call "ma_FFT Power Spectrum and PS Density no State (CDB).gvi"(time signal=$"time signal", window=$window, averaging parameters=$"averaging parameters", dB On (F)=$"dB On (F)", error in=$"error in (no error)", restart averaging (F)=w3, ps density=FALSE, state info=w4) -> (power spectrum=w5, averages completed=w6, error out=w1, averaging done=w7, state info 2=w8)
        next s1 = w8
        continue if FALSE
      }
      $"averaging done" <- w7
      $"power spectrum" <- w5
      $"averages completed" <- w6
    }
    frame Error {
      w1 = $"error in (no error)"
    }
  }
  $"Error Out" <- w1
