vi "FIR Filter with I.C. Compatibility (DBL).gvi"   [4.0.0.26867]
inputs:
  "X": f64[]
  "FIR Coefficients": f64[]
  "Initial X Conditions": f64[]
outputs:
  "Filtered X": f64[]
  "error": i32
  "Final X Conditions": f64[]
types:
  "filter structure.gtype" = u32
  "filter.gtype" = cluster{"filter structure": "filter structure.gtype", "forward coefficients": f64[], "reverse coefficients": f64[], "sampling frequency": f64}
uses:
  NI::Analysis::Filtering::Filtering with Initial Conditions (DBL).gvi
diagram:
  Property Node(instance in="filter.gtype" {all zero or empty}, "filter structure"="FIR"(3), "forward coefficients"=$"FIR Coefficients", "sampling frequency"=1) -> (instance out=w1)
  Property Node(instance in=cluster{"condition": f64[]} {all zero or empty}, "condition"=$"Initial X Conditions") -> (instance out=w2)
  call "Filtering with Initial Conditions (DBL).gvi"(signal=$X, filter=w1, initial conditions=w2) -> (filtered signal=w3, error out=w4, final conditions=w5)
  $"Filtered X" <- w3
  Property Node(instance in=w5) -> ("condition"=w6)
  $"Final X Conditions" <- w6
  Property Node(instance in=w4) -> ("code"=w7)
  $error <- w7
