vi "IIR Filter Compatibility (DBL).gvi"   [4.0.0.26867]
inputs:
  "X": f64[]
  "Reverse Coefficients": f64[]
  "Forward Coefficients": f64[]
  "init/cont (init:F)": bool
outputs:
  "Filtered X": f64[]
  "error": i32
types:
  "filter structure.gtype" = u32
  "filter.gtype" = cluster{"filter structure": "filter structure.gtype", "forward coefficients": f64[], "reverse coefficients": f64[], "sampling frequency": f64}
uses:
  NI::Analysis::Filtering::Filtering (DBL).gvi
diagram:
  Not(x=$"init/cont (init:F)") -> w1
  Property Node(instance in="filter.gtype" {all zero or empty}, "filter structure"="IIR Direct"(2), "forward coefficients"=$"Forward Coefficients", "reverse coefficients"=$"Reverse Coefficients", "sampling frequency"=1) -> (instance out=w2)
  call "Filtering (DBL).gvi"(signal=$X, filter=w2, reset=w1) -> (filtered signal=w3, error out=w4)
  $"Filtered X" <- w3
  Property Node(instance in=w4) -> ("code"=w5)
  $error <- w5
