vi "LO Adjust.gvi"   [LabVIEW Communications System Design Suite 2.0.1]
inputs:
  "niusrp in": "niUSRPClass"
  "Actual IQ Rate": f64
  "Actual Carrier Freq": f64
  "error in": error
outputs:
  "niusrp out": "niUSRPClass"
  "error out": error
diagram:
  Add($"Actual IQ Rate", $"Actual Carrier Freq") -> w1
  Property Node(instance in=$"niusrp in", "LO Frequency"=w1, error in=$"error in") -> (error out=w2, instance out=w3)
  $"niusrp out" <- w3
  $"error out" <- w2
