vi "Normalize Vector.gvi"   [LabVIEW NXG]
inputs:
  "Vector": f64[]
outputs:
  "Normalized Vector": f64[]
  "standard deviation": f64
  "mean": f64
  "error": i32
diagram:
  Add Array Elements(numeric array=$Vector) -> (sum=w1)
  Array Size(array=$Vector) -> (size(s)=w2)
  Divide(x=w1, y=w2) -> w3
  Subtract(x=$Vector, y=w3) -> w4
  Array Size(array=$Vector) -> (size(s)=w5)
  Subtract(x=$Vector, y=w3) -> w6
  Square(x=w6) -> w7
  Add Array Elements(numeric array=w7) -> (sum=w8)
  Divide(x=w8, y=w5) -> w9
  Absolute Value(x=w9) -> w10
  Square Root(x=w10) -> w11
  Divide(x=w4, y=w11) -> w12
  $"Normalized Vector" <- w12
  $mean <- w3
  $"standard deviation" <- w11
