vi "Quick Scale 1D.gvi"   [LabVIEW NXG]
inputs:
  "X": f64[]
outputs:
  "Y[i]=X[i]/Max|X|": f64[]
  "max|X|": f64
  "error": i32
diagram:
  Absolute Value(x=$X) -> w1
  Array Max And Min(array=w1) -> (max value=w2)
  Divide(x=$X, y=w2) -> w3
  $"Y[i]=X[i]/Max|X|" <- w3
  $"max|X|" <- w2
