vi "Ramp Pattern by Samples2.gvi"   [LabVIEW NXG]
inputs:
  "samples": i32 = 128
  "end": f64 = 1
  "start": f64
  "exclude end?": bool
  "type": u16
outputs:
  "ramp pattern": f64[]
  "error": i32
diagram:
  Boolean To Integer(Boolean=$"exclude end?") -> (0, 1=w1)
  Native Method Call(end=$end, noEnd=w1, size=$samples, start=$start, type=$type) -> (return=w2, xH out=w3)
  $error <- w2
  $"ramp pattern" <- w3
