vi "FnS.gvi"   [LabVIEW Communications System Design Software 2.0.1]
inputs:
  "Sampling Frequency": f64
  "data": c128[][]
outputs:
  "Sync IQ": c128[][]
uses:
  NI::Analysis::Filtering::Elliptic Highpass Filter NChan (DBL).gvi
  NI::Analysis::Filtering::Elliptic Lowpass Filter NChan (DBL).gvi
diagram:
  Complex To Real Imaginary(x + iy=$data) -> (x=w1, y=w2)
  call "Elliptic Highpass Filter NChan (DBL).gvi"(signal=w1, sampling frequency=$"Sampling Frequency", cutoff frequency=20000, passband ripple=0.01, stopband attenuation=200, order=8) -> (filtered signal=w3)
  call "Elliptic Highpass Filter NChan (DBL).gvi"(signal=w2, sampling frequency=$"Sampling Frequency", cutoff frequency=20000, passband ripple=0.01, stopband attenuation=200, order=8) -> (filtered signal=w4)
  Real And Imaginary To Complex(x=w3, y=w4) -> w5
  call "edgeRemover.gvi"(Input=w5) -> (Output=w6)
  call "Elliptic Lowpass Filter NChan (DBL).gvi"(signal=w1, sampling frequency=$"Sampling Frequency", cutoff frequency=15000, passband ripple=0.01, stopband attenuation=200, order=8) -> (filtered signal=w7)
  call "Elliptic Lowpass Filter NChan (DBL).gvi"(signal=w2, sampling frequency=$"Sampling Frequency", cutoff frequency=15000, passband ripple=0.01, stopband attenuation=200, order=8) -> (filtered signal=w8)
  Real And Imaginary To Complex(x=w7, y=w8) -> w9
  call "edgeRemover.gvi"(Input=w9) -> (Output=w10)
  call "Sync.gvi"(Sig=w6, LPF Sig=w10) -> (Sync'd Signals=w11)
  $"Sync IQ" <- w11
