vi "Main.gvi"   [LabVIEW Communications System Design Software 2.0.1]
panel controls:
  "IQ rate [S/sec]": f64 = 1000000
  "Carrier Frequency [Hz]": f64 = 900000000
  "Active Antenna": string = "RX1"
  "Gain": f64 = 10
  "Start Trigger Time": T1 = {"whole seconds"=0, "fractional seconds"=0.1}
  "Samples in Frame": i64 = 16384
  "Timeout": f64 = 10
  "Device IDs": "niUSRPClass" = "192.168.10.2; 192.168.10.3; 192.168.10.4; 192.168.10.5"
  "Stop": bool
  "Disp Data?": bool
  "Get Frame": bool
  "Sync IQ CSV Output": path
panel indicators:
  "Sync IQ": f64[][]
  "Raw IQ": f64[][]
  "Actual Rx Timestamp": T1
  "Baseband Power Spectrum": T2[]
  "Baseband Power Spectrum_Sync'd": T2[]
  "Beamforming Powr Plot": f64[]
  "Estimated Azimuth": f64
types:
  T1 = cluster{"whole seconds": u64, "fractional seconds": f64}
  T2 = cluster{"f0": f64, "df": f64, "magnitude": f64[]}
uses:
  NI::Analysis::Measurement::Power Spectrum for 1 Chan (CDB).gvi
diagram:
  call "niUSRP Open Rx Session.gvi"(device names=$"Device IDs", reset=TRUE) -> (error out=w1, session handle out=w2)
  Property Node(instance in=w2, "Enabled Channels"="0,1,2,3", "Number of Samples Is Finite"=TRUE, error in=w1) -> (error out=w3, instance out=w4)
  # Synchronized devices must use a Start Trigger.
  call "niUSRP Configure Time Start Trigger.gvi"(session handle=w4, start trigger time=$"Start Trigger Time", error in=w3) -> (session handle out=w5, error out=w6)
  Property Node(instance in=w5, "IQ Rate"=$"IQ rate [S/sec]", "Carrier Frequency"=$"Carrier Frequency [Hz]", error in=w6) -> ("IQ Rate"=w7, error out=w8, instance out=w9)
  call "Radio Init_Rx.gvi"(niusrp out=w9, error out=w8, Gain=$Gain, Active Antenna=$"Active Antenna", Reference Frequency Source="RefIn", Timebase Clock Source="PPSIn") -> (session handle=w10, error in (no error)=w11)
  Reciprocal(x=w7) -> w12
  while {
    Property Node(instance in=w10, "Number of Samples"=$"Samples in Frame", error in=w11) -> (error out=w13, instance out=w14)
    Feedback Node(input=w15) -> w16
    Feedback Node(input=w17) -> w18
    case ($"Get Frame") {
      frame False, Default {
        w17 = w18
        w15 = w16
      }
      frame True {
        call "niUSRP Set Time.gvi"(session handle=w14, apply timestamp="Next Timebase Edge", timestamp=T1 {all zero or empty}, error in=w13, channel list="0,1,2,3") -> (session handle out=w19, error out=w20)
        call "niUSRP Initiate.gvi"(session handle=w19, error in=w20) -> (session handle out=w21, error out=w22)
        call "niUSRP Fetch Rx Data (2D CDB).gvi"(session handle=w21, number of samples=$"Samples in Frame", timeout=$Timeout, error in=w22, channel list="0,1,2,3") -> (session handle out=w17, data=w23, timestamp=w24, error out=w15)
        for {
          w25 = each element of w23
          Property Node(instance in=waveform<c128> {all zero or empty}, "Y"=w25, "dt"=w12) -> (instance out=w27)
          call "Power Spectrum for 1 Chan (CDB).gvi"(signal=w27, dB on=TRUE) -> (power spectrum=w28)
          append w28 to w26
        }
        $"Baseband Power Spectrum" <- w26
        call "FnS.gvi"(Sampling Frequency=w7, data=w23) -> (Sync IQ=w29)
        for {
          w30 = each element of w29
          Property Node(instance in=waveform<c128> {all zero or empty}, "Y"=w30, "dt"=w12) -> (instance out=w32)
          call "Power Spectrum for 1 Chan (CDB).gvi"(signal=w32, dB on=TRUE) -> (power spectrum=w33)
          append w33 to w31
        }
        $"Baseband Power Spectrum_Sync'd" <- w31
        case ($"Disp Data?") {
          frame False, Default { }
          frame True {
            Complex To Real Imaginary(x + iy=w23) -> (x=w34, y=w35)
            Build Array[ConcatenateInputs=True](w34, w35) -> w36
            $"Raw IQ" <- w36
            Complex To Real Imaginary(x + iy=w29) -> (x=w37, y=w38)
            Build Array[ConcatenateInputs=True](w37, w38) -> w39
            $"Sync IQ" <- w39
          }
        }
        call "Beamforming.gvi"(M=3, Num Samples=$"Samples in Frame", Signal=w29, Angles=180) -> (Power=w40, Estimate=w41)
        $"Beamforming Powr Plot" <- w40
        $"Estimated Azimuth" <- w41
        Complex To Real Imaginary(x + iy=w29) -> (x=w42, y=w43)
        Build Array[ConcatenateInputs=True](w42, w43) -> w44
        call "Write to Spreadsheet File (DBL).gvi"(format="%.20g", file path=$"Sync IQ CSV Output", 2D data=w44, delimiter=",")
        $"Actual Rx Timestamp" <- w24
      }
    }
    Logical Or(w15, $Stop) -> w45
    stop if w45
  }
  call "niUSRP Abort.gvi"(session handle=w17, error in=w15) -> (session handle out=w46, error out=w47)
  call "niUSRP Close Session.gvi"(session handle=w46, error in=w47) -> (error out=w48)
  call "Simple Error Handler.gvi"(error in=w48)
