vi "Sync.gvi"   [LabVIEW Communications System Design Software 2.0.1]
inputs:
  "Sig": c128[][]
  "LPF Sig": c128[][]
outputs:
  "Sync'd Signals": c128[][]
diagram:
  Array Size(array=$"LPF Sig") -> (size(s)=w1)
  Array Index(array=w1) -> (out0[0]=w2)
  for (N = w2) (iteration -> i1) {
    Array Index(array=$"LPF Sig") -> (out0[0, _]=w4)
    Array Index(array=$"LPF Sig") -> (out0[i1, _]=w5)
    Divide(x=w4, y=w5) -> w6
    append w6 to w3
  }
  for (N = w2) (iteration -> i2) {
    Array Index(array=$Sig) -> (out0[i2, _]=w8)
    Array Index(array=w3) -> (out0[i2, _]=w9)
    Multiply(w8, w9) -> w10
    append w10 to w7
  }
  $"Sync'd Signals" <- w7
