vi "edgeRemover.gvi"   [LabVIEW Communications System Design Software 2.0.1]
inputs:
  "Input": c128[][]
outputs:
  "Output": c128[][]
diagram:
  Array Size(array=$Input) -> (size(s)=w1)
  Array Index(array=w1) -> (out0[1]=w2)
  Subtract(x=w2, y=1000) -> w3
  Array Subset(array=$Input, index1=1000, length1=w3) -> w4
  $Output <- w4
