vi "Rx Multiple Synchronized Inputs.gvi"   [LabVIEW Communications System Design Software 2.0.1]
panel controls:
  "IQ rate [S/sec]": f64 = 1000000
  "Carrier Frequency [Hz]": f64 = 2000000000
  "Active Antenna": string = "RX1"
  "Gain": f64 = 10
  "Start Trigger Time": T1 = {"whole seconds"=0, "fractional seconds"=0.1}
  "Number of Samples Per Fetch": i64 = 16384
  "Timeout": f64 = 10
  "Stop": bool
  "Device IDs": "niUSRPClass" = "192.168.10.2; 192.168.10.3"
  "Num_samples_beamforming": f64
  "Calibrate": bool
panel indicators:
  "Actual Rx Timestamp": T1
  "Baseband Power Spectrum": T2[]
  "IQ Graph": f64[][]
  "Estimated Azimuth": f64
  "Beamforming Phase Difference": c128[]
  "MUSIC Spectrum": f64[]
  "Data Array": c128[][]
types:
  T1 = cluster{"whole seconds": u64, "fractional seconds": f64}
  T2 = cluster{"f0": f64, "df": f64, "magnitude": f64[]}
uses:
  NI::Analysis::Measurement::Power Spectrum for 1 Chan (CDB).gvi
  NI::Analysis::Filtering::Elliptic Highpass Filter NChan (DBL).gvi
  NI::Analysis::Filtering::Elliptic Lowpass Filter NChan (DBL).gvi
  NI::Analysis::Generation::Ramp Pattern by Increment.gvi
  NI::Analysis::LinearAlgebra::Real Outer Product.gvi
  NI::Analysis::LinearAlgebra::Complex A x B.gvi
diagram:
  w1 = $"Carrier Frequency [Hz]"
  call "niUSRP Open Rx Session.gvi"(niUSRP Device=$"Device IDs", reset=TRUE) -> (error out=w2, session handle out=w3)
  Property Node(instance in=w3, "Enabled Channels"="0,1,2,3", error in=w2) -> (error out=w4, instance out=w5)
  # Synchronized devices must use a Start Trigger.
  call "niUSRP Configure Time Start Trigger.gvi"(session handle=w5, start trigger time=$"Start Trigger Time", error in (no error)=w4) -> (session handle out=w6, Error Out=w7)
  Property Node(instance in=w6, "IQ Rate"=$"IQ rate [S/sec]", "Carrier Frequency"=w1, error in=w7) -> ("IQ Rate"=w8, error out=w9, instance out=w10)
  # coerced IQ rate
  # sample period
  Reciprocal(x=w8) -> w11
  w12 = "RefIn"  # Reference Frequency Source
  # Set the attributes common to all channels.
  w13 = "PPSIn"  # Timebase Clock Source
  Property Node(instance in=w10, sub-item="0", "Gain"=$Gain, "Active Antenna"=$"Active Antenna", "Reference Frequency Source"=w12, "Timebase Clock Source"=w13, error in=w9) -> (error out=w14, instance out=w15)
  Property Node(instance in=w15, sub-item="1", "Gain"=$Gain, "Active Antenna"=$"Active Antenna", "Reference Frequency Source"=w12, "Timebase Clock Source"=w13, error in=w14) -> (error out=w16, instance out=w17)
  Property Node(instance in=w17, sub-item="2", "Gain"=$Gain, "Active Antenna"=$"Active Antenna", "Reference Frequency Source"=w12, "Timebase Clock Source"=w13, error in=w16) -> (error out=w18, instance out=w19)
  Property Node(instance in=w19, sub-item="3", "Gain"=$Gain, "Active Antenna"=$"Active Antenna", "Reference Frequency Source"=w12, "Timebase Clock Source"=w13, error in=w18) -> (error out=w20, instance out=w21)
  call "niUSRP Set Time.gvi"(session handle=w21, apply timestamp="Now", timestamp=T1 {all zero or empty}, error in (no error)=w20, channel list="0,1,2,3") -> (session handle out=w22, Error Out=w23)
  call "niUSRP Initiate.gvi"(session handle=w22, error in (no error)=w23) -> (session handle out=w24, Error Out=w25)
  # Set the internal
  # clocks back to
  # time 0.
  s1 = w25  # shift register
  while (iteration -> i1) {
    call "niUSRP Fetch Rx Data (2D CDB).gvi"(session handle=w24, number of samples=$"Number of Samples Per Fetch", timeout=$Timeout, error in (no error)=s1, channel list="0,1,2,3") -> (session handle out=w26, data=w27, timestamp=w28, Error Out=w29)
    s2 = f64[][] []  # shift register
    for {
      w30 = each element of w27
      Complex To Real Imaginary(x + iy=w30) -> (x=w31, y=w32)
      Build Array[ConcatenateInputs=True](s2, w31, w32) -> w33
      next s2 = w33
    }
    $"IQ Graph" <- s2
    Quotient And Remainder(x=i1, y=128) -> (x-y*floor(x/y)=w34)
    case (w34) {
      frame Default { }
      frame 0 {
        for {
          w35 = each element of w27
          Property Node(instance in=waveform<c128> {all zero or empty}, "Y"=w35, "dt"=w11) -> (instance out=w37)
          call "Power Spectrum for 1 Chan (CDB).gvi"(signal=w37, dB on=TRUE) -> (power spectrum=w38)
          append w38 to w36
        }
        $"Baseband Power Spectrum" <- w36
      }
    }
    $"Actual Rx Timestamp" <- w28
    Logical Or(w29, $Stop) -> w39
    Complex To Real Imaginary(x + iy=w27) -> (x=w40, y=w41)
    call "Elliptic Highpass Filter NChan (DBL).gvi"(signal=w40, sampling frequency=w8, cutoff frequency=20000, passband ripple=0.1, stopband attenuation=200, order=8) -> (filtered signal=w42)
    call "Elliptic Highpass Filter NChan (DBL).gvi"(signal=w41, sampling frequency=w8, cutoff frequency=20000, passband ripple=0.1, stopband attenuation=200, order=8) -> (filtered signal=w43)
    Real And Imaginary To Complex(x=w42, y=w43) -> w44
    call "edgeRemover.gvi"(Input=w44) -> (Output=w45)
    call "Elliptic Lowpass Filter NChan (DBL).gvi"(signal=w40, sampling frequency=w8, cutoff frequency=15000, passband ripple=0.1, stopband attenuation=200, order=8) -> (filtered signal=w46)
    call "Elliptic Lowpass Filter NChan (DBL).gvi"(signal=w41, sampling frequency=w8, cutoff frequency=15000, passband ripple=0.1, stopband attenuation=200, order=8) -> (filtered signal=w47)
    Real And Imaginary To Complex(x=w46, y=w47) -> w48
    call "edgeRemover.gvi"(Input=w48) -> (Output=w49)
    call "Sync.gvi"(Sig=w45, LPF Sig=w49) -> (Sync'd Signals=w50)
    case ($Calibrate) {
      frame False, Default {
        w51 = default
      }
      frame True {
        Math Node("S"=w50) -> ("Weights"=w51)
        ~~~
        sz = size(S);
        angs = (-90:90)*pi/180;
        steering = exp(-j*pi*(0:sz(1)-1)'*sin(angs));
        spectrum = sum(S'*steering);
        [v,pos] = max(spectrum);
        Weights = steering(:,pos)';
        ~~~
      }
    }
    Multiply(w50, w51) -> w52
    case (w34) {
      frame 0 {
        Array Subset(array=w52, length1=$Num_samples_beamforming) -> w53
        Math Node("s"=w53) -> ("MUSIC_SPECTRUM"=w54)
        ~~~
        %Derived Extra informations/variable declaration
        size_s = (size(s))
        num_sigs= size_s(1)
        num_samples = size_s(2)
        d = 0.1666;
        c_f = 9e8;
        %Covariance Estimation -> s is a row vector
        estimated_covariance = s*s'
        R_inv = inv(estimated_covariance)
        %get key for sorted eig's
        %temp = abs(ones(1,num_sigs)*n);
        %[sorted_list,prev_indices] = sort(temp)
        %Assuming that we're only looking at 1 signal
        %num_sigs-1 smallest eigenvalues
        %noise_vector =zeros(num_sigs,num_sigs-1)
        %for i = 1:(num_sigs-1)
        %    noise_vector(:,i) = v(:,prev_indices(i))
        %end
        %sweep space until orthogonal component is found
        theta_sweep = (-180:180)*pi/180
        steering_vector = exp(j*[0:num_sigs-1]'*theta_sweep);
        MS = zeros(1,length(steering_vector))
        for i = 1:length(steering_vector)
            MS(i) = diag(steering_vector(:,i)'*R_inv*R_inv'*steering_vector(:,i));
        end
        MUSIC_SPECTRUM = abs(MS.^-1);
        ~~~
        $"MUSIC Spectrum" <- w54
        Negate(x=180) -> w55
        call "Ramp Pattern by Increment.gvi"(increment=1, end=180, start=w55) -> (ramp pattern=w56)
        Divide(x=w56, y=180) -> w57
        Multiply(w57, Pi) -> w58
        Sine(x=w58) -> w59
        Multiply(w59, Pi) -> w60
        Real And Imaginary To Complex(x=0, y=w60) -> w61
        Exponential(x=w61) -> w62
        call "Ramp Pattern by Increment.gvi"(increment=1, end=3, start=0) -> (ramp pattern=w63)
        call "Real Outer Product.gvi"(vector x=w63, vector y=w60) -> (outer product=w64)
        Real And Imaginary To Complex(x=0, y=w64) -> w65
        Exponential(x=w65) -> w66
        Transpose 2D Array(2D array=w66) -> (transposed array=w67)
        call "Complex A x B.gvi"(matrix A=w67, matrix B=w53) -> (A x B=w68)
        Absolute Value(x=w68) -> w69
        Square(x=w69) -> w70
        for {
          w71 = each element of w70
          Add Array Elements(numeric array=w71) -> (sum=w73)
          append w73 to w72
        }
        Divide(x=w72, y=$"Number of Samples Per Fetch") -> w74
        Multiply(w74, w62) -> w75
        $"Beamforming Phase Difference" <- w75
        Complex To Polar(r * e^(i*theta)=w75) -> (r=w76)
        Array Max And Min(array=w76) -> (max index(es)=w77)
        Array Index(array=w75) -> (out0[w77]=w78)
        Complex To Polar(r * e^(i*theta)=w78) -> (theta=w79)
        Divide(x=w79, y=PiTimes2) -> w80
        Multiply(w80, SpeedOfLight) -> w81
        Divide(x=w81, y=w1) -> w82
        Divide(x=w82, y=0.1667) -> w83
        Inverse Sine(x=w83) -> w84
        Multiply(w84, 180) -> w85
        Divide(x=w85, y=Pi) -> w86
        $"Estimated Azimuth" <- w86
        $"Data Array" <- w53
      }
      frame Default { }
    }
    next s1 = w29
    stop if w39
  }
  call "niUSRP Abort.gvi"(Handle in=w26, error in (no error)=s1) -> (Handle out=w87, Error Out=w88)
  call "niUSRP Close Session.gvi"(handle in=w87, error in=w88) -> (error out=w89)
  call "Simple Error Handler.gvi"(error in=w89)
