vi "Rx Multiple Synchronized Inputs.gvi"   [LabVIEW Communications System Design Software 2.0.1]
panel controls:
  "IQ rate [S/sec]": f64 = 1000000
  "Carrier Frequency [Hz]": f64 = 2000000000
  "Active Antenna": string = "RX1"
  "Gain": f64 = 10
  "Start Trigger Time": T1 = {"whole seconds"=0, "fractional seconds"=0.1}
  "Number of Samples Per Fetch": i64 = 16384
  "Timeout": f64 = 10
  "Stop": bool
  "Device IDs": "niUSRPClass" = "192.168.10.2; 192.168.10.3"
  "Num_samples_beamforming": f64
  "Calibrate": bool
panel indicators:
  "Actual Rx Timestamp": T1
  "IQ Graph": f64[][]
  "Estimated Azimuth": f64
  "Beamforming Phase Difference": c128[]
  "Data Array": c128[][]
  "Graph": f64[][]
  "Graph_2": f64[][]
types:
  T1 = cluster{"whole seconds": u64, "fractional seconds": f64}
uses:
  NI::Analysis::Filtering::Elliptic Lowpass Filter NChan (DBL).gvi
  NI::Analysis::Filtering::Elliptic Bandpass Filter NChan (DBL).gvi
  NI::Analysis::Generation::Ramp Pattern by Increment.gvi
  NI::Analysis::LinearAlgebra::Real Outer Product.gvi
  NI::Analysis::LinearAlgebra::Complex A x B.gvi
diagram:
  w1 = $"Carrier Frequency [Hz]"
  call "niUSRP Open Rx Session.gvi"(niUSRP Device=$"Device IDs", reset=TRUE) -> (error out=w2, session handle out=w3)
  Property Node(instance in=w3, "Enabled Channels"="0,1,2,3", error in=w2) -> (error out=w4, instance out=w5)
  # Synchronized devices must use a Start Trigger.
  call "niUSRP Configure Time Start Trigger.gvi"(session handle=w5, start trigger time=$"Start Trigger Time", error in (no error)=w4) -> (session handle out=w6, Error Out=w7)
  Property Node(instance in=w6, "IQ Rate"=$"IQ rate [S/sec]", "Carrier Frequency"=w1, error in=w7) -> ("IQ Rate"=w8, error out=w9, instance out=w10)
  # coerced IQ rate
  # sample period
  Reciprocal(x=w8) -> w11
  w12 = "RefIn"  # Reference Frequency Source
  # Set the attributes common to all channels.
  w13 = "PPSIn"  # Timebase Clock Source
  Property Node(instance in=w10, sub-item="0", "Gain"=$Gain, "Active Antenna"=$"Active Antenna", "Reference Frequency Source"=w12, "Timebase Clock Source"=w13, error in=w9) -> (error out=w14, instance out=w15)
  Property Node(instance in=w15, sub-item="1", "Gain"=$Gain, "Active Antenna"=$"Active Antenna", "Reference Frequency Source"=w12, "Timebase Clock Source"=w13, error in=w14) -> (error out=w16, instance out=w17)
  Property Node(instance in=w17, sub-item="2", "Gain"=$Gain, "Active Antenna"=$"Active Antenna", "Reference Frequency Source"=w12, "Timebase Clock Source"=w13, error in=w16) -> (error out=w18, instance out=w19)
  Property Node(instance in=w19, sub-item="3", "Gain"=$Gain, "Active Antenna"=$"Active Antenna", "Reference Frequency Source"=w12, "Timebase Clock Source"=w13, error in=w18) -> (error out=w20, instance out=w21)
  call "niUSRP Set Time.gvi"(session handle=w21, apply timestamp="Now", timestamp=T1 {all zero or empty}, error in (no error)=w20, channel list="0,1,2,3") -> (session handle out=w22, Error Out=w23)
  call "niUSRP Initiate.gvi"(session handle=w22, error in (no error)=w23) -> (session handle out=w24, Error Out=w25)
  # Set the internal
  # clocks back to
  # time 0.
  s1 = w25  # shift register
  while (iteration -> i1) (after w11) {
    call "niUSRP Fetch Rx Data (2D CDB).gvi"(session handle=w24, number of samples=$"Number of Samples Per Fetch", timeout=$Timeout, error in (no error)=s1, channel list="0,1,2,3") -> (session handle out=w26, data=w27, timestamp=w28, Error Out=w29)
    s2 = f64[][] []  # shift register
    for {
      w30 = each element of w27
      Complex To Real Imaginary(x + iy=w30) -> (x=w31, y=w32)
      Build Array[ConcatenateInputs=True](s2, w31, w32) -> w33
      next s2 = w33
    }
    $"IQ Graph" <- s2
    $"Actual Rx Timestamp" <- w28
    Logical Or(w29, $Stop) -> w34
    Complex To Real Imaginary(x + iy=w27) -> (x=w35, y=w36)
    call "Elliptic Lowpass Filter NChan (DBL).gvi"(signal=w35, sampling frequency=w8, cutoff frequency=15000, passband ripple=0.01, stopband attenuation=200, order=8) -> (filtered signal=w37)
    call "Elliptic Lowpass Filter NChan (DBL).gvi"(signal=w36, sampling frequency=w8, cutoff frequency=15000, passband ripple=0.01, stopband attenuation=200, order=8) -> (filtered signal=w38)
    Real And Imaginary To Complex(x=w37, y=w38) -> w39
    call "edgeRemover.gvi"(Input=w39) -> (Output=w40)
    call "Elliptic Bandpass Filter NChan (DBL).gvi"(signal=w35, sampling frequency=w8, high cutoff frequency=150000, low cutoff frequency=20000, passband ripple=0.01, stopband attenuation=200, order=8) -> (filtered signal=w41)
    call "Elliptic Bandpass Filter NChan (DBL).gvi"(signal=w36, sampling frequency=w8, high cutoff frequency=150000, low cutoff frequency=20000, passband ripple=0.01, stopband attenuation=200, order=8) -> (filtered signal=w42)
    Real And Imaginary To Complex(x=w41, y=w42) -> w43
    call "edgeRemover.gvi"(Input=w43) -> (Output=w44)
    call "Sync.gvi"(Sig=w40, LPF Sig=w44) -> (Sync'd Signals=w45)
    Quotient And Remainder(x=i1, y=128) -> (x-y*floor(x/y)=w46)
    case (w46) {
      frame 0 {
        Negate(x=180) -> w47
        call "Ramp Pattern by Increment.gvi"(increment=1, end=180, start=w47) -> (ramp pattern=w48)
        Divide(x=w48, y=180) -> w49
        Multiply(w49, Pi) -> w50
        Real And Imaginary To Complex(x=0, y=w50) -> w51
        Exponential(x=w51) -> w52
        Array Subset(array=w45, length1=$Num_samples_beamforming) -> w53
        call "Ramp Pattern by Increment.gvi"(increment=1, end=3, start=0) -> (ramp pattern=w54)
        call "Real Outer Product.gvi"(vector x=w54, vector y=w50) -> (outer product=w55)
        Real And Imaginary To Complex(x=0, y=w55) -> w56
        Exponential(x=w56) -> w57
        Transpose 2D Array(2D array=w57) -> (transposed array=w58)
        call "Complex A x B.gvi"(matrix A=w58, matrix B=w53) -> (A x B=w59)
        Absolute Value(x=w59) -> w60
        Square(x=w60) -> w61
        for {
          w62 = each element of w61
          Add Array Elements(numeric array=w62) -> (sum=w64)
          append w64 to w63
        }
        Divide(x=w63, y=$"Number of Samples Per Fetch") -> w65
        Multiply(w65, w52) -> w66
        Add(w66, 1) -> w67
        Logarithm Base 10(x=w67) -> w68
        $"Beamforming Phase Difference" <- w68
        Complex To Polar(r * e^(i*theta)=w66) -> (r=w69)
        Array Max And Min(array=w69) -> (max index(es)=w70)
        Array Index(array=w66) -> (out0[w70]=w71)
        Complex To Polar(r * e^(i*theta)=w71) -> (theta=w72)
        Divide(x=w72, y=Pi) -> w73
        Inverse Sine(x=w73) -> w74
        $"Estimated Azimuth" <- w74
        $"Data Array" <- w53
      }
      frame Default { }
    }
    Complex To Real Imaginary(x + iy=w39) -> (x=w75, y=w76)
    Build Array[ConcatenateInputs=True](w75, w76) -> w77
    $Graph_2 <- w77
    Complex To Real Imaginary(x + iy=w45) -> (x=w78, y=w79)
    Build Array[ConcatenateInputs=True](w78, w79) -> w80
    $Graph <- w80
    case ($Calibrate) {
      frame False, Default { }
      frame True {
        Math Node("S"=w45) -> ("Weights"=w81)
        ~~~
        sz = size(S);
        angs = (-90:90)*pi/180;
        steering = exp(-j*pi*(0:sz(1)-1)'*sin(angs));
        spectrum = sum(S'*steering);
        [v,pos] = max(spectrum);
        Weights = steering(:,pos)';
        ~~~
      }
    }
    next s1 = w29
    stop if w34
  }
  call "niUSRP Abort.gvi"(Handle in=w26, error in (no error)=s1) -> (Handle out=w82, Error Out=w83)
  call "niUSRP Close Session.gvi"(handle in=w82, error in=w83) -> (error out=w84)
  call "Simple Error Handler.gvi"(error in=w84)
