vi "Sync.gvi"   [LabVIEW Communications System Design Software 2.0.1]
inputs:
  "Sig": c128[][]
  "LPF Sig": c128[][]
outputs:
  "Sync'd Signals": c128[][]
uses:
  NI::Analysis::Statistics::Measures of Mean.gvi
diagram:
  Array Size(array=$"LPF Sig") -> (size(s)=w1)
  Array Index(array=w1) -> (out0[0]=w2)
  for (N = w2) (iteration -> i1) {
    Array Index(array=$"LPF Sig") -> (out0[0, _]=w4)
    Array Index(array=$"LPF Sig") -> (out0[i1, _]=w5)
    Divide(x=w4, y=w5) -> w6
    Natural Logarithm(x=w6) -> w7
    Complex To Real Imaginary(x + iy=w7) -> (y=w8)
    Absolute Value(x=w8) -> w9
    call "Measures of Mean.gvi"(x=w9) -> (mean value=w10)
    append w10 to w3
  }
  for (N = w2) (iteration -> i2) {
    Array Index(array=$Sig) -> (out0[i2, _]=w12)
    Real And Imaginary To Complex(x=0, y=w3) -> w13
    Exponential(x=w13) -> w14
    Array Index(array=w14) -> (out0[i2]=w15)
    Multiply(w12, w15) -> w16
    append w16 to w11
  }
  $"Sync'd Signals" <- w11
