vi "sync_signal.gvi"   [LabVIEW Communications System Design Software 2.0.1]
inputs:
  "Frequency": f64
  "IQ Rate": f64
  "Num Samples": f64
outputs:
  "Out": c128[]
uses:
  NI::Analysis::Generation::Sine Waveform.gvi
diagram:
  call "Sine Waveform.gvi"(frequency=$Frequency, phase in=90, sample rate=$"IQ Rate", samples=$"Num Samples") -> (sine wave=w1)
  Property Node(instance in=w1) -> ("Y"=w2)
  call "Sine Waveform.gvi"(frequency=$Frequency, sample rate=$"IQ Rate", samples=$"Num Samples") -> (sine wave=w3)
  Property Node(instance in=w3) -> ("Y"=w4)
  Real And Imaginary To Complex(x=w2, y=w4) -> w5
  $Out <- w5
